# Grasshopper definition physics_example.gh (Grasshopper 1.0.7)
# plug-ins: Weaverbird, Kangaroo2 Components

# ----
# Damping Catenary
number_slider = Slider(1, range=0..1)
timer = Timer(TimerInterval=50, Target=data_recorder)  # disabled
line = Line(Line((-1, 0, 1), (837, 0, 1)))
data_recorder = DataRecorder(number_slider, DataLimit=-10, RecordData=True)
divide_curve = DivideCurve(Curve=line, Count=Slider(10, range=0..100), Kinks=False)  # -> Points, Tangents, Parameters
ghpython_script = GhPythonScript(x=data_recorder)  # -> out, a; inputs x: list
# ---------- ghpython_script: Python ----------
__author__ = "saywo"
__version__ = "2020.08.26"

import rhinoscriptsyntax as rs

a= sum(x)
# ---------- end ghpython_script ----------
polyline = PolyLine(Vertices=divide_curve.Points, Closed=False)
panel = Panel(ghpython_script.a)
c_script = CSharpScript(pl=polyline, num=ghpython_script.a)  # -> out, A; inputs pl: Polyline, num: Int32
# ---------- c_script: C# usings ----------
using System.Linq;
# ---------- c_script: C# ----------
    Point3d start = pl.First;
    Point3d end = pl.Last;
    Vector3d force = new Vector3d(0, 0, -10);

    // Create vectices
    var vs = new List<Vertex>();
    vs.Add(new Vertex(0, true, start));
    for (int i = 1; i < pl.Count - 1; i++)
    {
      vs.Add(new Vertex(i, false, pl[i]));
    }
    vs.Add(new Vertex(pl.Count - 1, true, end));

    var sps = new List<Spring>();
    var lns = pl.GetSegments();
    for (int i = 0; i < pl.Count - 1; i++)
    {
      sps.Add(new Spring(i, i + 1, lns[i].Length));
    }


    // Create Spring
    PhysicsNetwork graph = new PhysicsNetwork(vs, sps);
    for (int i = 0; i < num; i++)
    {

      graph.EstimateForce();
      graph.Update();
      // Print(graph.ToString());
    }

    A = graph.Vertices.Select(n => n.position).ToList();
# ---------- c_script: C# additional code ----------
  public class PhysicsNetwork
  {
    /// <summary>
    /// Spring constant in Hook's law
    /// </summary>
    private double K = 20;

    /// <summary>
    /// Damping coefficient
    /// </summary>
    private double damping = 2;

    /// <summary>
    /// Gravity accerleration
    /// </summary>
    private Vector3d gravityA = new Vector3d(0, 0, -10);

    /// <summary>
    /// mass of each vectex
    /// </summary>
    private double particleMass = 20;

    public Vertex[] Vertices;
    private Spring[] Springs;
    public PhysicsNetwork(IEnumerable<Vertex> vertices, IEnumerable<Spring> springs)
    {
      Vertices = vertices.ToArray();
      Springs = springs.ToArray();
    }

    public int CountOfVertex()
    {
      return Vertices.Length;
    }

    private Tuple<Vertex[], Spring[]> FindAdjacents(int id)
    {
      var vertices = new List<Vertex>();
      var springs = new List<Spring>();
      foreach (var s in Springs)
      {
        if (s.IsConnected(id))
        {
          Spring spring = s;
          int vertexId = s.GetOther(id);
          Vertex vertex = Vertices.Single(n => n.Id == vertexId);

          vertices.Add(vertex);
          springs.Add(s);
        }
      }

      return new Tuple<Vertex[], Spring[]>(vertices.ToArray(), springs.ToArray());
    }

    /// <summary>
    ///
    /// </summary>
    /// <param name="outerForce">generally gravity</param>
    public void EstimateForce()
    {
      Vector3d gravity = gravityA * particleMass;
      foreach (Vertex v in Vertices)
      {
        Vector3d springForce = new Vector3d();
        // Sum of elastic force
        Tuple<Vertex[], Spring[]> adjs = FindAdjacents(v.Id);
        for (int i = 0; i < adjs.Item1.Length; i++)
        {
          Vertex other = adjs.Item1[i];
          Spring s = adjs.Item2[i];
          double dist = v.position.DistanceTo(other.position);
          double stringLength = s.Length;
          if (dist <= stringLength)
          {
            continue;
          }

          double diff = dist - stringLength;

          double coef = (-1) * this.K * diff;
          Vector3d dir = v.position - other.position;
          dir.Unitize();
          Vector3d elasticForce = dir * coef;

          springForce += elasticForce;
        }
        Vector3d dampingForce = damping * v.currentVelocity;
        Vector3d force = gravity + springForce - dampingForce;
        v.EstimateExpected(force, particleMass);
      }
    }

    public void Update()
    {
      foreach (var v in Vertices)
      {
        v.Update();
      }
    }

    public override string ToString()
    {
      string s = string.Empty;
      foreach (Vertex v in Vertices)
      {
        s += v.ToString();
        s += "\n";
      }
      foreach (Spring sp in Springs)
      {
        s += sp.ToString();
        s += "\n";
      }
      return s;
    }
  }

  public class Spring
  {
    /// <summary>
    /// Hook's law coefficient
    /// </summary>
    public const double K = 0.9;
    private HashSet<int> connection;
    public double Length;

    public Spring(int id1, int id2, double length)
    {
      this.connection = new HashSet<int> { id1, id2 };
      Length = length;
    }

    public bool IsConnected(int i)
    {
      return connection.Contains(i);
    }

    public int GetOther(int id)
    {
      int a = connection.First();
      int b = connection.Last();

      if (a == id)
      {
        return b;
      }
      else if (b == id)
      {
        return a;
      }
      throw new Exception();
    }
  }


  public class Vertex
  {
    private const double timeUnit = 0.5;

    public readonly int Id;
    public Vector3d currentVelocity = new Vector3d();

    public bool isAnchor;
    public Point3d position;
    public Point3d? expected;

    public Vertex(int id, bool isAnchor, Point3d position)
    {
      this.Id = id;
      this.isAnchor = isAnchor;
      this.position = position;
    }

    public void Update()
    {
      if (!expected.HasValue)
      {
        throw new Exception("None expected value");
      }

      this.position = expected.Value;
      this.expected = null;
    }

    public void EstimateExpected(Vector3d force, double mass)
    {
      if (isAnchor)
      {
        this.expected = this.position;
        return;
      }

      Vector3d a = force * (1 / mass);
      Vector3d nextVelocity = currentVelocity + a * timeUnit;
      Point3d nextPositon = this.position + (nextVelocity * timeUnit);

      this.expected = nextPositon;
      this.currentVelocity = nextVelocity;
    }


    public override string ToString()
    {
      return this.position.X.ToString() + "," + this.position.Y.ToString() + "," + this.position.Z.ToString();
    }
  }
# ---------- end c_script ----------
polyline_2 = PolyLine(Vertices=c_script.A, Closed=False)

# ----
# No Damping Catenary
number_slider_2 = Slider(1, range=0..1)
timer_2 = Timer(TimerInterval=50, Target=data_recorder_2)  # disabled
line_2 = Line(Line((-1, 0, 1), (837, 0, 1)))
data_recorder_2 = DataRecorder(number_slider_2, DataLimit=-10, RecordData=True)
divide_curve_2 = DivideCurve(Curve=line_2, Count=Slider(10, range=0..100), Kinks=False)  # -> Points, Tangents, Parameters
ghpython_script_2 = GhPythonScript(x=data_recorder_2)  # -> out, a; inputs x: list; same code as ghpython_script
polyline_3 = PolyLine(Vertices=divide_curve_2.Points, Closed=False)
panel_3 = Panel(ghpython_script_2.a)
c_script_2 = CSharpScript(pl=polyline_3, num=ghpython_script_2.a)  # -> out, A; inputs pl: Polyline, num: Int32
# ---------- c_script_2: C# ----------
    Point3d start = pl.First;
    Point3d end = pl.Last;
    Vector3d force = new Vector3d(0, 0, -10);

    // Create vectices
    var vs = new List<Vertex>();
    vs.Add(new Vertex(0, true, start));
    for (int i = 1; i < pl.Count - 1; i++)
    {
      vs.Add(new Vertex(i, false, pl[i]));
    }
    vs.Add(new Vertex(pl.Count - 1, true, end));

    var sps = new List<Spring>();
    var lns = pl.GetSegments();
    for (int i = 0; i < pl.Count - 1; i++)
    {
      sps.Add(new Spring(i, i + 1, lns[i].Length));
    }


    // Create Spring
    PhysicsNetwork graph = new PhysicsNetwork(vs, sps);
    for (int i = 0; i < num; i++)
    {

      graph.EstimateForce();
      graph.Update();
      // Print(graph.ToString());
    }

    A = graph.Vertices.Select(n => n.position).ToList();
# ---------- c_script_2: C# additional code ----------
  public class PhysicsNetwork
  {
    /// <summary>
    /// Spring constant in Hook's law
    /// </summary>
    private double K = 20;

    /// <summary>
    /// Damping coefficient
    /// </summary>
    private double damping = 0.9;

    /// <summary>
    /// Gravity accerleration
    /// </summary>
    private Vector3d gravityA = new Vector3d(0, 0, -10);

    /// <summary>
    /// mass of each vectex
    /// </summary>
    private double particleMass = 20;

    public Vertex[] Vertices;
    private Spring[] Springs;
    public PhysicsNetwork(IEnumerable<Vertex> vertices, IEnumerable<Spring> springs)
    {
      Vertices = vertices.ToArray();
      Springs = springs.ToArray();
    }

    public int CountOfVertex()
    {
      return Vertices.Length;
    }

    private Tuple<Vertex[], Spring[]> FindAdjacents(int id)
    {
      var vertices = new List<Vertex>();
      var springs = new List<Spring>();
      foreach (var s in Springs)
      {
        if (s.IsConnected(id))
        {
          Spring spring = s;
          int vertexId = s.GetOther(id);
          Vertex vertex = Vertices.Single(n => n.Id == vertexId);

          vertices.Add(vertex);
          springs.Add(s);
        }
      }

      return new Tuple<Vertex[], Spring[]>(vertices.ToArray(), springs.ToArray());
    }

    /// <summary>
    ///
    /// </summary>
    /// <param name="outerForce">generally gravity</param>
    public void EstimateForce()
    {
      Vector3d gravity = gravityA * particleMass;
      foreach (Vertex v in Vertices)
      {
        Vector3d springForce = new Vector3d();
        // Sum of elastic force
        Tuple<Vertex[], Spring[]> adjs = FindAdjacents(v.Id);
        for (int i = 0; i < adjs.Item1.Length; i++)
        {
          Vertex other = adjs.Item1[i];
          Spring s = adjs.Item2[i];
          double dist = v.position.DistanceTo(other.position);
          double stringLength = s.Length;
          if (dist <= stringLength)
          {
            continue;
          }

          double diff = dist - stringLength;

          double coef = (-1) * this.K * diff;
          Vector3d dir = v.position - other.position;
          dir.Unitize();
          Vector3d elasticForce = dir * coef;

          springForce += elasticForce;
        }

        Vector3d force = gravity + springForce;
        v.EstimateExpected(force, particleMass);
      }
    }

    public void Update()
    {
      foreach (var v in Vertices)
      {
        v.Update();
      }
    }

    public override string ToString()
    {
      string s = string.Empty;
      foreach (Vertex v in Vertices)
      {
        s += v.ToString();
        s += "\n";
      }
      foreach (Spring sp in Springs)
      {
        s += sp.ToString();
        s += "\n";
      }
      return s;
    }
  }

  public class Spring
  {
    /// <summary>
    /// Hook's law coefficient
    /// </summary>
    public const double K = 0.9;
    private HashSet<int> connection;
    public double Length;

    public Spring(int id1, int id2, double length)
    {
      this.connection = new HashSet<int> { id1, id2 };
      Length = length;
    }

    public bool IsConnected(int i)
    {
      return connection.Contains(i);
    }

    public int GetOther(int id)
    {
      int a = connection.First();
      int b = connection.Last();

      if (a == id)
      {
        return b;
      }
      else if (b == id)
      {
        return a;
      }
      throw new Exception();
    }
  }


  public class Vertex
  {
    private const double timeUnit = 0.5;

    public readonly int Id;
    private Vector3d currentVelocity = new Vector3d();

    public bool isAnchor;
    public Point3d position;
    public Point3d? expected;

    public Vertex(int id, bool isAnchor, Point3d position)
    {
      this.Id = id;
      this.isAnchor = isAnchor;
      this.position = position;
    }

    public void Update()
    {
      if (!expected.HasValue)
      {
        throw new Exception("None expected value");
      }

      this.position = expected.Value;
      this.expected = null;
    }

    public void EstimateExpected(Vector3d force, double mass)
    {
      if (isAnchor)
      {
        this.expected = this.position;
        return;
      }

      Vector3d a = force * (1 / mass);
      Vector3d nextVelocity = currentVelocity + a * timeUnit;
      Point3d nextPositon = this.position + (nextVelocity * timeUnit);

      this.expected = nextPositon;
      this.currentVelocity = nextVelocity;
    }


    public override string ToString()
    {
      return this.position.X.ToString() + "," + this.position.Y.ToString() + "," + this.position.Z.ToString();
    }
  }
# ---------- end c_script_2 ----------
polyline_4 = PolyLine(Vertices=c_script_2.A, Closed=False)

# ----
# Dampping Spring
number_slider_3 = Slider(148, range=1..300)
timer_3 = Timer(TimerInterval=5, Target=data_recorder_3)  # disabled
data_recorder_3 = DataRecorder(Slider(1, range=0..1), DataLimit=-10, RecordData=True)
panel_5 = Panel(data_recorder_3)
ghpython_script_3 = GhPythonScript(x=data_recorder_3)  # -> a; inputs x: list
# ---------- ghpython_script_3: Python ----------
a= sum(x)
# ---------- end ghpython_script_3 ----------
ghpython_script_4 = GhPythonScript(x=ghpython_script_3, damping=Slider(1, range=0..10))  # -> out, a, b; inputs x: Int32
# ---------- ghpython_script_4: Python ----------
__author__ = "saywo"
__version__ = "2020.08.27"

import rhinoscriptsyntax as rs

# Gravity force
g = rs.CreateVector(0,0,-10)
# mass
m = 10
# initial location
location = rs.AddPoint(0,0,200)
# Initial velocity
velocity = rs.CreateVector(0,0,0)
# Anchor point
anchor = rs.AddPoint(0,0,181)
# acceleration
ac = 0
# Hook's coef
k=2
# time unit
t = 0.28


for i in range(x):
    
    springF = -k * rs.PointSubtract(location, anchor)
    dampingF = velocity * damping
    force = g*m + springF - dampingF
    ac = force / m
    
    velocity = velocity + t * ac
    ds = velocity * t
    
    location = rs.PointAdd(location,ds)
    a = rs.AddSphere(location,3)
    b = rs.AddLine(location, anchor)
# ---------- end ghpython_script_4 ----------
panel_6 = Panel(ghpython_script_4.out)

# ----
# No Damping Spring
number_slider_4 = Slider(148, range=1..300)
timer_4 = Timer(TimerInterval=5, Target=data_recorder_4)  # disabled
data_recorder_4 = DataRecorder(Slider(1, range=0..1), DataLimit=-10, RecordData=True)
panel_7 = Panel(data_recorder_4)
ghpython_script_5 = GhPythonScript(x=data_recorder_4)  # -> a; inputs x: list; same code as ghpython_script_3
number_slider_5 = Slider(10, range=0..200)
ghpython_script_6 = GhPythonScript(x=ghpython_script_5)  # -> out, a, b; inputs x: Int32
# ---------- ghpython_script_6: Python ----------
__author__ = "saywo"
__version__ = "2020.08.27"

import rhinoscriptsyntax as rs

# Gravity force
g = rs.CreateVector(0,0,-10)
# mass
m = 10
# initial location
location = rs.AddPoint(0,0,200)
# Initial velocity
velocity = rs.CreateVector(0,0,0)
# Anchor point
anchor = rs.AddPoint(0,0,181)
# acceleration
ac = 0
# Hook's coef
k=2
# time unit
t = 0.28


for i in range(x):
    
    springF = -k * rs.PointSubtract(location, anchor)
    force = g*m + springF 
    ac = force / m
    
    velocity = velocity + t * ac
    ds = velocity * t
    
    location = rs.PointAdd(location,ds)
    a = rs.AddSphere(location,3)
    b = rs.AddLine(location, anchor)
# ---------- end ghpython_script_6 ----------
panel_8 = Panel(ghpython_script_6.out)

# ----
# No Damping Membrane
number_slider_6 = Slider(10, range=0..10)
number_slider_7 = Slider(10, range=0..100)
surface = Surface(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)
timer_5 = Timer(TimerInterval=50, Target=data_recorder_5)  # disabled
mesh_surface = MeshSurface(Surface=surface, UCount=number_slider_6, VCount=number_slider_6, Overhang=True, Equalize=False)
data_recorder_5 = DataRecorder(Slider(1, range=0..1), DataLimit=-10, RecordData=True)
weaverbird_s_vertices_component = WeaverbirdsVerticesComponent(MeshClosedPolylinesGroup=mesh_surface, Weld=True)
ghpython_script_7 = GhPythonScript(x=data_recorder_5)  # -> out, a; inputs x: list; same code as ghpython_script
meshcorners = MeshCorners(Mesh=surface, Angle=2.35619449)
weaverbird_s_mesh_edges = WeaverbirdsMeshEdges(MeshOrPolylines=mesh_surface)
panel_9 = Panel(ghpython_script_7.a)
c_script_3 = CSharpScript(pts=weaverbird_s_vertices_component, lns=weaverbird_s_mesh_edges, num=ghpython_script_7.a, cons=meshcorners)  # -> out, A, B; inputs pts: list of Point3d, lns: list of Line, num: Int32, cons: list of Point3d
# ---------- c_script_3: C# ----------
    // Create vectices
    var vs = new List<Vertex>();
    for (int i = 0; i < pts.Count; i++)
    {
      Point3d pt = pts[i];
      if(cons.Contains(pt))
      {
        vs.Add(new Vertex(i, true, pt));
      }
      else
      {
        vs.Add(new Vertex(i, false, pt));
      }
    }

    var sps = new List<Spring>();
    for (int i = 0; i < lns.Count; i++)
    {
      Line ln = lns[i];
      int id1 = pts.IndexOf(ln.From);
      int id2 = pts.IndexOf(ln.To);
      sps.Add(new Spring(id1, id2, ln.Length));
    }


    // Create Spring
    PhysicsNetwork graph = new PhysicsNetwork(vs, sps);
    for (int i = 0; i < num; i++)
    {
      graph.EstimateForce();
      graph.Update();
      // Print(graph.ToString());
    }

    A = graph.Vertices.Select(n => n.position).ToList();
    B = graph.Springs.Select(n => new Line(vs[n.connection.First()].position, vs[n.connection.Last()].position)).ToList();
# ---------- c_script_3: C# additional code ----------
  public class PhysicsNetwork
  {
    /// <summary>
    /// Spring constant in Hook's law
    /// </summary>
    private double K = 30;

    /// <summary>
    /// Damping coefficient
    /// </summary>
    private double damping = 0;

    /// <summary>
    /// Gravity accerleration
    /// </summary>
    private Vector3d gravityA = new Vector3d(0, 0, -10);

    /// <summary>
    /// mass of each vectex
    /// </summary>
    private double particleMass = 20;

    public Vertex[] Vertices;
    public Spring[] Springs;
    public PhysicsNetwork(IEnumerable<Vertex> vertices, IEnumerable<Spring> springs)
    {
      Vertices = vertices.ToArray();
      Springs = springs.ToArray();
    }

    public int CountOfVertex()
    {
      return Vertices.Length;
    }

    private Tuple<Vertex[], Spring[]> FindAdjacents(int id)
    {
      var vertices = new List<Vertex>();
      var springs = new List<Spring>();
      foreach (var s in Springs)
      {
        if (s.IsConnected(id))
        {
          Spring spring = s;
          int vertexId = s.GetOther(id);
          Vertex vertex = Vertices.Single(n => n.Id == vertexId);

          vertices.Add(vertex);
          springs.Add(s);
        }
      }

      return new Tuple<Vertex[], Spring[]>(vertices.ToArray(), springs.ToArray());
    }

    /// <summary>
    ///
    /// </summary>
    /// <param name="outerForce">generally gravity</param>
    public void EstimateForce()
    {
      Vector3d gravity = gravityA * particleMass;
      foreach (Vertex v in Vertices)
      {
        Vector3d springForce = new Vector3d();
        // Sum of elastic force
        Tuple<Vertex[], Spring[]> adjs = FindAdjacents(v.Id);
        for (int i = 0; i < adjs.Item1.Length; i++)
        {
          Vertex other = adjs.Item1[i];
          Spring s = adjs.Item2[i];
          double dist = v.position.DistanceTo(other.position);
          double stringLength = s.Length;
          if (dist <= stringLength)
          {
            continue;
          }

          double diff = dist - stringLength;

          double coef = (-1) * this.K * diff;
          Vector3d dir = v.position - other.position;
          dir.Unitize();
          Vector3d elasticForce = dir * coef;

          springForce += elasticForce;
        }
        Vector3d dampingForce = damping * v.currentVelocity;
        Vector3d force = gravity + springForce - dampingForce;
        v.EstimateExpected(force, particleMass);
      }
    }

    public void Update()
    {
      foreach (var v in Vertices)
      {
        v.Update();
      }
    }

    public override string ToString()
    {
      string s = string.Empty;
      foreach (Vertex v in Vertices)
      {
        s += v.ToString();
        s += "\n";
      }
      foreach (Spring sp in Springs)
      {
        s += sp.ToString();
        s += "\n";
      }
      return s;
    }
  }

  public class Spring
  {
    /// <summary>
    /// Hook's law coefficient
    /// </summary>
    public const double K = 0.9;
    public HashSet<int> connection;
    public double Length;

    public Spring(int id1, int id2, double length)
    {
      this.connection = new HashSet<int> { id1, id2 };
      Length = length;
    }

    public bool IsConnected(int i)
    {
      return connection.Contains(i);
    }

    public int GetOther(int id)
    {
      int a = connection.First();
      int b = connection.Last();

      if (a == id)
      {
        return b;
      }
      else if (b == id)
      {
        return a;
      }
      throw new Exception();
    }
  }


  public class Vertex
  {
    private const double timeUnit = 0.5;

    public readonly int Id;
    public Vector3d currentVelocity = new Vector3d();

    public bool isAnchor;
    public Point3d position;
    public Point3d? expected;

    public Vertex(int id, bool isAnchor, Point3d position)
    {
      this.Id = id;
      this.isAnchor = isAnchor;
      this.position = position;
    }

    public void Update()
    {
      if (!expected.HasValue)
      {
        throw new Exception("None expected value");
      }

      this.position = expected.Value;
      this.expected = null;
    }

    public void EstimateExpected(Vector3d force, double mass)
    {
      if (isAnchor)
      {
        this.expected = this.position;
        return;
      }

      Vector3d a = force * (1 / mass);
      Vector3d nextVelocity = currentVelocity + a * timeUnit;
      Point3d nextPositon = this.position + (nextVelocity * timeUnit);

      this.expected = nextPositon;
      this.currentVelocity = nextVelocity;
    }


    public override string ToString()
    {
      return this.position.X.ToString() + "," + this.position.Y.ToString() + "," + this.position.Z.ToString();
    }
  }
# ---------- end c_script_3 ----------
panel_10 = Panel(c_script_3.out)

# ----
# Damping Membrane
number_slider_8 = Slider(10, range=0..10)
number_slider_9 = Slider(10, range=0..100)
surface_2 = Surface(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)
timer_6 = Timer(TimerInterval=50, Target=data_recorder_6)  # disabled
mesh_surface_2 = MeshSurface(Surface=surface_2, UCount=number_slider_8, VCount=number_slider_8, Overhang=True, Equalize=False)
data_recorder_6 = DataRecorder(Slider(1, range=0..1), DataLimit=-10, RecordData=True)
weaverbird_s_vertices_component_2 = WeaverbirdsVerticesComponent(MeshClosedPolylinesGroup=mesh_surface_2, Weld=True)
ghpython_script_8 = GhPythonScript(x=data_recorder_6)  # -> out, a; inputs x: list; same code as ghpython_script
meshcorners_2 = MeshCorners(Mesh=surface_2, Angle=2.35619449)
weaverbird_s_mesh_edges_2 = WeaverbirdsMeshEdges(MeshOrPolylines=mesh_surface_2)
panel_11 = Panel(ghpython_script_8.a)
c_script_4 = CSharpScript(pts=weaverbird_s_vertices_component_2, lns=weaverbird_s_mesh_edges_2, num=ghpython_script_8.a, cons=meshcorners_2)  # -> out, A, B; inputs pts: list of Point3d, lns: list of Line, num: Int32, cons: list of Point3d
# ---------- c_script_4: C# ----------
    // Create vectices
    var vs = new List<Vertex>();
    for (int i = 0; i < pts.Count; i++)
    {
      Point3d pt = pts[i];
      if(cons.Contains(pt))
      {
        vs.Add(new Vertex(i, true, pt));
      }
      else
      {
        vs.Add(new Vertex(i, false, pt));
      }
    }

    var sps = new List<Spring>();
    for (int i = 0; i < lns.Count; i++)
    {
      Line ln = lns[i];
      int id1 = pts.IndexOf(ln.From);
      int id2 = pts.IndexOf(ln.To);
      sps.Add(new Spring(id1, id2, ln.Length));
    }


    // Create Spring
    PhysicsNetwork graph = new PhysicsNetwork(vs, sps);
    for (int i = 0; i < num; i++)
    {
      graph.EstimateForce();
      graph.Update();
      // Print(graph.ToString());
    }

    A = graph.Vertices.Select(n => n.position).ToList();
    B = graph.Springs.Select(n => new Line(vs[n.connection.First()].position, vs[n.connection.Last()].position)).ToList();
# ---------- c_script_4: C# additional code ----------
  public class PhysicsNetwork
  {
    /// <summary>
    /// Spring constant in Hook's law
    /// </summary>
    private double K = 30;

    /// <summary>
    /// Damping coefficient
    /// </summary>
    private double damping = 2;

    /// <summary>
    /// Gravity accerleration
    /// </summary>
    private Vector3d gravityA = new Vector3d(0, 0, -10);

    /// <summary>
    /// mass of each vectex
    /// </summary>
    private double particleMass = 20;

    public Vertex[] Vertices;
    public Spring[] Springs;
    public PhysicsNetwork(IEnumerable<Vertex> vertices, IEnumerable<Spring> springs)
    {
      Vertices = vertices.ToArray();
      Springs = springs.ToArray();
    }

    public int CountOfVertex()
    {
      return Vertices.Length;
    }

    private Tuple<Vertex[], Spring[]> FindAdjacents(int id)
    {
      var vertices = new List<Vertex>();
      var springs = new List<Spring>();
      foreach (var s in Springs)
      {
        if (s.IsConnected(id))
        {
          Spring spring = s;
          int vertexId = s.GetOther(id);
          Vertex vertex = Vertices.Single(n => n.Id == vertexId);

          vertices.Add(vertex);
          springs.Add(s);
        }
      }

      return new Tuple<Vertex[], Spring[]>(vertices.ToArray(), springs.ToArray());
    }

    /// <summary>
    ///
    /// </summary>
    /// <param name="outerForce">generally gravity</param>
    public void EstimateForce()
    {
      Vector3d gravity = gravityA * particleMass;
      foreach (Vertex v in Vertices)
      {
        Vector3d springForce = new Vector3d();
        // Sum of elastic force
        Tuple<Vertex[], Spring[]> adjs = FindAdjacents(v.Id);
        for (int i = 0; i < adjs.Item1.Length; i++)
        {
          Vertex other = adjs.Item1[i];
          Spring s = adjs.Item2[i];
          double dist = v.position.DistanceTo(other.position);
          double stringLength = s.Length;
          if (dist <= stringLength)
          {
            continue;
          }

          double diff = dist - stringLength;

          double coef = (-1) * this.K * diff;
          Vector3d dir = v.position - other.position;
          dir.Unitize();
          Vector3d elasticForce = dir * coef;

          springForce += elasticForce;
        }
        Vector3d dampingForce = damping * v.currentVelocity;
        Vector3d force = gravity + springForce - dampingForce;
        v.EstimateExpected(force, particleMass);
      }
    }

    public void Update()
    {
      foreach (var v in Vertices)
      {
        v.Update();
      }
    }

    public override string ToString()
    {
      string s = string.Empty;
      foreach (Vertex v in Vertices)
      {
        s += v.ToString();
        s += "\n";
      }
      foreach (Spring sp in Springs)
      {
        s += sp.ToString();
        s += "\n";
      }
      return s;
    }
  }

  public class Spring
  {
    /// <summary>
    /// Hook's law coefficient
    /// </summary>
    public const double K = 0.9;
    public HashSet<int> connection;
    public double Length;

    public Spring(int id1, int id2, double length)
    {
      this.connection = new HashSet<int> { id1, id2 };
      Length = length;
    }

    public bool IsConnected(int i)
    {
      return connection.Contains(i);
    }

    public int GetOther(int id)
    {
      int a = connection.First();
      int b = connection.Last();

      if (a == id)
      {
        return b;
      }
      else if (b == id)
      {
        return a;
      }
      throw new Exception();
    }
  }


  public class Vertex
  {
    private const double timeUnit = 0.5;

    public readonly int Id;
    public Vector3d currentVelocity = new Vector3d();

    public bool isAnchor;
    public Point3d position;
    public Point3d? expected;

    public Vertex(int id, bool isAnchor, Point3d position)
    {
      this.Id = id;
      this.isAnchor = isAnchor;
      this.position = position;
    }

    public void Update()
    {
      if (!expected.HasValue)
      {
        throw new Exception("None expected value");
      }

      this.position = expected.Value;
      this.expected = null;
    }

    public void EstimateExpected(Vector3d force, double mass)
    {
      if (isAnchor)
      {
        this.expected = this.position;
        return;
      }

      Vector3d a = force * (1 / mass);
      Vector3d nextVelocity = currentVelocity + a * timeUnit;
      Point3d nextPositon = this.position + (nextVelocity * timeUnit);

      this.expected = nextPositon;
      this.currentVelocity = nextVelocity;
    }


    public override string ToString()
    {
      return this.position.X.ToString() + "," + this.position.Y.ToString() + "," + this.position.Z.ToString();
    }
  }
# ---------- end c_script_4 ----------
panel_12 = Panel(c_script_4.out)
